# Grasshopper definition MRT_Mixed.ghx (Grasshopper 1.0.8)
# plug-ins: Outdoor, Eddy3D-Radiance

brep = Brep(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)

# ---- group: Ground Surface
brep_2 = Brep(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)

# ----
number_slider = Slider(3, range=0..10)
context = Brep([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])
entwine = Entwine(Branch00=brep_2, Branch01=brep, FlattenInputs=True)  # -> flatten(Result)

hoy = HourOfYear(
    StartMonth=Slider(1, range=1..12),
    StartDay=Slider(1, range=1..30),
    StartHour=Slider(0, range=0..23),
    EndMonth=Slider(12, range=1..12),
    EndDay=Slider(31, range=1..31),
    EndHour=Slider(23, range=0..23))  # -> HoursOfYear, DateTimes
calendar = Calendar(Day=24, Hour=15, Month=7)

brep_join = BrepJoin(Breps=entwine)  # -> Breps, Closed
brepgrid = BrepGridPoints(Geometry=brep_join.Breps, Spacing=number_slider)  # -> Points, Vectors, Mesh, Status
brepgrid_2 = BrepGridPoints(Geometry=brep, Spacing=number_slider)  # -> Points, Vectors, Mesh, Status
preview = CustomPreview(Geometry=context, Material=ColourSwatch(SwatchColor=RGB(255, 255, 255)))
download_weather = DownloadWeather(Search="Istanbul")  # -> EPWFile, Logs, Stations
mrt_surface = MRTSurface(Geometry=brep_join.Breps, Type="Ground", Simulated=True, PatchSize=3)  # -> Surface, Mesh
mrt_surface_2 = MRTSurface(Geometry=context, Type="Building", Simulated=True, PatchSize=3)  # -> Surface, Mesh
mrt_sensors = MRTSensors(Sensors=brepgrid.Points, Normal=Vector(0, 0, 1), Height=1.1)  # -> Sensors, Points
mrt_view_factors = MRTViewFactors(
    Surfaces=[mrt_surface_2.Surface, mrt_surface.Surface],
    Sensors=mrt_sensors.Sensors,
    SkyDomeSubdivisions="2 — 48 sky patches",
    Fidelity="Fast",
    Run=Button())  # -> VFModel, SkyDome
mrt_solve = MRTSolve(VFModel=mrt_view_factors.VFModel, EPW=download_weather.EPWFile, Engine="Native", Run=Button())  # -> Probes, Result
deconstruct_mrt = DeconstructMRT(Result=mrt_solve.Result)  # -> Points, Mean, Min, Max, MRT

# ---- group: Mean
bnd = Bounds(Numbers=deconstruct_mrt.Mean)
dedomain = DeconstructDomain(Domain=bnd)  # -> Start, End
gradient = Gradient(
    LowerLimit=dedomain.Start,
    UpperLimit=dedomain.End,
    Parameter=deconstruct_mrt.Mean,
    stops=[0: RGB(48, 18, 59), 0.0294: RGB(56, 40, 112), 0.0588: RGB(63, 62, 156), 0.0882: RGB(68, 82, 193), 0.118: RGB(70, 102, 221), 0.147: RGB(71, 122, 241)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])
cir = Circle(Plane=deconstruct_mrt.Points, Radius=1)
srf = Surface(cir)
preview_2 = CustomPreview(Geometry=srf, Material=gradient)
round = Round(Number=deconstruct_mrt.Mean)  # -> Nearest, Floor, Ceiling
tag = TextTag(Location=brepgrid.Points, Text=round.Nearest, Colour=ColourSwatch(SwatchColor=RGB(255, 255, 255)))
