# Grasshopper definition Sun_Hours.ghx (Grasshopper 1.0.8)
# plug-ins: Outdoor, Eddy3D, Eddy3D-Radiance

quad_remesh_settings = QuadRemeshSettings(TargetCount="20000", AdaptiveSize=0, AdaptiveCount=True, HardEdges=True, SeamEdges=1, Symmetry=0, GuideCurves=0)
quad_remesh_settings_2 = QuadRemeshSettings(TargetCount="20000", AdaptiveSize=0, AdaptiveCount=True, HardEdges=True, SeamEdges=1, Symmetry=0, GuideCurves=0)
surface = Surface(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)
# Description: Purpose: Annual direct-sun hours across a site and its context.
# Fidelity: Screening - geometric direct beam only; no diffuse or reflected light, not Radiance.
# Method: Hourly ray casting toward the sun for every daylight hour of an Atlanta year; tree crowns pass 20 percent of the beam.
# Result: Points and a mesh coloured by annual sun hours.
# Needs: Nothing to install; runs inside Rhino. Runtime: seconds to minutes, growing with point count.
# Edit: Context meshes, ground surface, canopy crowns, weather station.
geometry = Geometry([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])
mjoin = MeshJoin(Meshes=geometry)
quad_remesh = QuadRemesh(Geometry=mjoin, Settings=quad_remesh_settings_2)
quad_remesh_2 = QuadRemesh(Geometry=surface, Settings=quad_remesh_settings)
mjoin_2 = MeshJoin(Meshes=flatten([quad_remesh, quad_remesh_2]))
brep_grid_points = BrepGridPoints(Geometry=mjoin_2, Spacing="6")  # -> Points, Vectors, Mesh, Status
download_weather = DownloadWeather(Station="Atlanta", ChartMonthFrom=1, ChartMonthTo=12)  # -> EPWFile, Logs, Stations, Station, ExtraFiles, SiteLatitude, SiteLongitude
geometry_2 = Geometry([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])
canopy = Canopy(Geometry=geometry_2, CrownTransmittance=0.2, PerCrossing=False, LeafOn=0, LeafOff=0)  # -> Canopy, Report
deconstruct_mesh = DeconstructMesh(Mesh=brep_grid_points.Mesh)  # -> Vertices, Faces, Colours, Normals
weather = Weather(EPWFilePath=download_weather.EPWFile)
panel = Panel(canopy.Report)
sun_hours = SunHours(
    Context=quad_remesh,
    Points=deconstruct_mesh.Vertices,
    Weather=weather,
    StartHour=0,
    EndHour=8760,
    Timestep=1,
    North=0,
    Offset=0.01,
    Canopy=canopy.Canopy,
    SunHoursInputLayoutVersion=2)  # -> SunHours, Fraction, Colors, Report
panel_2 = Panel(sun_hours.Report)

# ---- group: Mean
bnd = Bounds(Numbers=sun_hours.SunHours)
dedomain = DeconstructDomain(Domain=bnd)  # -> Start, End
gradient = Gradient(
    LowerLimit=dedomain.Start,
    UpperLimit=dedomain.End,
    Parameter=sun_hours.SunHours,
    stops=[0: RGB(48, 18, 59), 0.0294: RGB(56, 40, 112), 0.0588: RGB(63, 62, 156), 0.0882: RGB(68, 82, 193), 0.118: RGB(70, 102, 221), 0.147: RGB(71, 122, 241)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])

# ----
construct_mesh = ConstructMesh(Vertices=deconstruct_mesh.Vertices, Faces=deconstruct_mesh.Faces, Colours=gradient)
