# Grasshopper definition CylinderDomain.ghx (Grasshopper 1.0.8)
# plug-ins: Outdoor, Eddy3D

# Description: Purpose: Pedestrian-level wind around an Atlanta site for every prevailing wind direction, solved on one mesh.
# Fidelity: Engineering - steady RANS, not validated for this site. Cite: Kastner and Dogan (2020), cylindrical mesh.
# Method: Steady RANS in OpenFOAM on a cylindrical mesh; Wind Rose Cluster reduces the EPW to up to 8 directions and speeds.
# Result: Velocity U probed 1.5 m above terrain, one direction per slider step.
# Needs: Eddy3D Setup > (U)RANS CFD (OpenFOAM). Runtime: hours.
# Edit: Station, site coordinates, buildings, tree zones; toggle Fetch for land cover and terrain.
# Related work to cite:
# 
# Kastner, P., & Dogan, T. (2020).
# A cylindrical meshing methodology
#  for annual urban computational fluid dynamics
# simulations. Journal of Building Performance Simulation, 13(1), 59-68.
# 
# Kastner, P., & Dogan, T. (2022).
# Eddy3D: A toolkit for decoupled
# outdoor thermal comfort simulations
# in urban areas. Building and Environment, 212, 108639.
download_weather = DownloadWeather(Station="Atlanta", Latitude="33.78145186480617", Longitude="-84.37722219362138", ChartMonthFrom=1, ChartMonthTo=12)  # -> EPWFile, Logs, Stations, Station, ExtraFiles, SiteLatitude, SiteLongitude
deconstruct_weather = DeconstructWeather(
    Weather=download_weather.EPWFile,
    Series="""Dry Bulb Temperature
Relative Humidity
Wind Speed
Wind Direction
Solar Elevation
Solar Azimuth
Hour of Year
Latitude
Longitude""")  # -> DryBulbTemperature, RelativeHumidity, WindSpeed, WindDirection, SolarElevation, SolarAzimuth, HourOfYear, Latitude, Longitude
wind_rose_cluster = WindRoseCluster(
    Directions=deconstruct_weather.WindDirection,
    Budget="6",
    WindSpeeds=deconstruct_weather.WindSpeed,
    Series="""Wind Directions
Wind Speeds""")  # -> WindDirections, WindSpeeds
site_context = SiteContext(
    Latitude="33.78145186480617",
    Longitude="-84.37722219362138",
    Radius="150",
    TerrainRadius="375",
    Buildings=True,
    Terrain=True,
    Trees=True,
    LandCover=True,
    FallbackHeight=9,
    WindDirections=wind_rose_cluster.WindDirections,
    BuildingSource="Global Building Atlas",
    Fetch=Toggle(True),
    SiteContextInputLayoutVersion=2)  # -> Buildings, Building_Heights, Height_Sources, Terrain, Site_Elevation, Tree_Crowns, Tree_Points, Tree_Heights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
mesh_join = MeshJoin(Meshes=site_context.Tree_Crowns)
geometry = Geometry(site_context.Terrain)
geometry_2 = Geometry(site_context.Buildings)
tree = Tree(Geometry=mesh_join, Type="dense")
mesh_settings = MeshSettings(
    RefinementBoxLevel="3",
    BuildingSurfaceLevel="4",
    BuildingFeatureLevel="4",
    GroundSurfaceLevel="4",
    LayerCount="3",
    AddLayers=True,
    Snap=True,
    GradingStrengthHorizontal=6,
    GradingStrengthVertical=6,
    AdaptiveGrading=True,
    CellsBetweenLevels=-1)
atmospheric_boundary_layer = AtmosphericBoundaryLayer(
    WindDirections=wind_rose_cluster.WindDirections,
    WindSpeed=wind_rose_cluster.WindSpeeds,
    ReferenceHeight=10,
    RoughnessLengthZ0=1,
    GroundHeight=0,
    TurbulentKEK=0.015,
    TurbulentEpsilonΕ=0.135,
    TurbulentOmegaΩ=100,
    TerrainType="Custom (z0 input)",
    Z0PerDirection=site_context.z0_m,
    InletProfile="Log law (Richards & Hoxey)",
    DisplacementHeight=0,
    AblOutputLayoutVersion=2)  # -> BoundaryConditions, WindVectors
run_settings = RunSettings(
    Iterations=1000,
    WriteInterval=20,
    KeepTimeSteps=3,
    TurbulenceModel="realizableKE",
    CPUCount=-1,
    SolverAlgorithm="SIMPLE",
    AgeOfAir=False,
    Numerics="0,0.5,0.5",
    PotentialFoamInit=True,
    WarmUpIterations=-1,
    FieldMonitors=False,
    PedestrianAverage=True,
    PressureCoefficient=False,
    Convergence=0.0001,
    AutoStopOnPlateau=True,
    Duration=-1,
    TimeStep=-1,
    MaxCourant=-1,
    AveragingWindow=-1,
    PressureSolver="GAMG",
    LaplacianScheme="auto",
    MeshQualityPreset="auto",
    PedestrianHeight=1.75,
    Guideline="None",
    ConcurrentDirections=1,
    EmptyDomainCheck=False)  # -> RunSettings, DebugLogs
cylinder_domain = CylinderDomain(
    CoreCellSize="40",
    InnerCoreSize=-1,
    OuterRadius="350",
    Height=-1,
    RadialMultiplier=2,
    CoreDivisions=1,
    RefinementBoxExtension=-1,
    RadialGrading=1,
    CoreRoundness=0.65,
    VerticalGrading="35")
outdoor_case = OutdoorCase(
    BoundaryConditions=atmospheric_boundary_layer.BoundaryConditions,
    DomainParameters=cylinder_domain,
    Buildings=site_context.Buildings,
    Trees=tree,
    Terrain=site_context.Terrain,
    MeshSettings=mesh_settings,
    RunSettings=run_settings.RunSettings,
    PedestrianSpacing=Slider(2, range=0..10),
    Engine="Containerized",
    Write=False,
    ClearCase=False,
    AutoName="merry-lemur-dune-quill",
    AutoWrapGeometry=False,
    OutdoorCaseInputLayoutVersion=7,
    PreviewBuildings=False,
    PreviewDimensions=True,
    PreviewGrid3D=True,
    PreviewGroundGrid=True,
    PreviewRefinementBox=True,
    PreviewWindArrows=True,
    RepairGeometry=True)  # -> Logs, WriteLogs, Case, Domain, RefinementBox, Buildings, PedestrianPoints
live_residuals = LiveResiduals(Case=outdoor_case.Case, Live=True, DirectionDegrees=-1, ShowResidualGoals=True)
plot_residuals = PlotResiduals(Case=outdoor_case.Case, Plot=False, ResidualViewerTarget=0)
geometry_3 = Geometry(outdoor_case.Domain)
meshing_progress = MeshingProgress(Case=outdoor_case.Case, Live=False)  # -> Progress, Phase, Done, Status
parse_case_logs = ParseCaseLogs(Case=outdoor_case.Case, Run=False)  # -> LogSummary, Errors, Warnings
run = Run(
    Case=outdoor_case.Case,
    Mesh=False,
    CreateZones=False,
    Simulate=False,
    RunAll=False,
    Parallel=True,
    DirectionIndex=-1,
    ShowZones=True)
open_in_paraview = OpenInParaView(Case=outdoor_case.Case, Open=False, ComfortMetric=1, DirectionIndex=-1, ParaviewInputLayoutVersion=2, Streamlines=True)
panel = Panel([meshing_progress.Progress, meshing_progress.Phase, meshing_progress.Done, meshing_progress.Status, parse_case_logs.LogSummary])
probe = Probe(
    Case=outdoor_case.Case,
    Points=outdoor_case.PedestrianPoints,
    Field="U",
    Time="latestTime",
    Run=False,
    AutoProbeName="sunny-ferret-mesa-compass",
    BakeTimeHistory=False,
    CullHugeVectors=False,
    CullInvalid=False,
    ShowCulled=False,
    ShowRegion=False)  # -> Values, TimeSteps, SubResults, Points
vector_field_viewer = VectorFieldViewer(
    Points=probe.Points,
    Velocity=probe.Values,
    DisplayMode="Vector Field",
    Scale=1,
    ColorMap="Viridis",
    SeedCount=120,
    ArrowheadScaling="Linear",
    VectorPlane="3D")  # -> Geometry, Colors, Range
